# Dynamo graph Fluxo hidraulico_script.dyn "Fluxo hidraulico - 13" (Dynamo 2.16.2.5624)

# group: Input
# note: Altere este campo caso o nome da família de tag principal seja alterado. Desta forma, ele sempre aparecerá em primeiro na lista de tags
tag_principal = StringInput("TAG-FLUXO.DIAMETRO COMPACTA")

formulário = Python(IN[0]=tag_principal)  # CPython3
# ---------- formulário.python (192 lines) ----------
import clr
clr.AddReference('System.Windows.Forms')
clr.AddReference('System.Drawing')
clr.AddReference('RevitAPI')
clr.AddReference('RevitServices')
clr.AddReference('RevitNodes')
clr.AddReference('RevitAPIUI')

from System.Windows.Forms import Application, Form, ComboBox, Label, Button, ComboBoxStyle, FormStartPosition, AnchorStyles
from System.Drawing import Point, Size, Color
from Autodesk.Revit.DB import BuiltInCategory, FilteredElementCollector, FamilySymbol
from Autodesk.Revit.UI import TaskDialog, UIApplication
from Autodesk.Revit.UI.Selection import ObjectType
from RevitServices.Persistence import DocumentManager

# Variável global para armazenar os resultados do formulário
global result, selected_element
result = None
selected_element = None

tag_principal = IN[0]
doc = DocumentManager.Instance.CurrentDBDocument

class MyForm(Form):
    def __init__(self):
        self.Text = "Tags de fluxo automáticas"
        self.Size = Size(340, 400)
        self.StartPosition = FormStartPosition.CenterScreen
        self.FormBorderStyle = 1
        self.MaximizeBox = False
        self.MinimizeBox = False
        self.ShowIcon = False

        # Configuração do tema Dark
        self.BackColor = Color.FromArgb(45, 45, 48)
        self.ForeColor = Color.White

        # Label e DropDownList para Família da Tag
        self.label_tag_family = Label()
        self.label_tag_family.Text = "Família da Tag"
        self.label_tag_family.Location = Point(20, 20)
        self.Controls.Add(self.label_tag_family)

        self.dropdown_tag_family = ComboBox()
        self.dropdown_tag_family.Location = Point(140, 20)
        self.dropdown_tag_family.Size = Size(150, 30)
        self.dropdown_tag_family.DropDownStyle = ComboBoxStyle.DropDownList
        self.Controls.Add(self.dropdown_tag_family)

        # Preencher a DropDownList com os nomes das Tags de Tubos
        self.populate_tag_families()

        # Label e DropDownList para Posição da Tag
        self.label_tag_pos = Label()
        self.label_tag_pos.Text = "Posição da Tag"
        self.label_tag_pos.Location = Point(20, 70)
        self.Controls.Add(self.label_tag_pos)

        self.dropdown_tag_pos = ComboBox()
        self.dropdown_tag_pos.Items.Add("Tag acima")
        self.dropdown_tag_pos.Items.Add("Tag abaixo")
        self.dropdown_tag_pos.SelectedIndex = 0
        self.dropdown_tag_pos.Location = Point(140, 70)
        self.dropdown_tag_pos.Size = Size(150, 30)
        self.dropdown_tag_pos.DropDownStyle = ComboBoxStyle.DropDownList
        self.Controls.Add(self.dropdown_tag_pos)

        # Label e DropDownList para Comprimento mínimo
        self.label_min_length = Label()
        self.label_min_length.Text = "Tolerância (cm)"
        self.label_min_length.Location = Point(20, 120)
        self.Controls.Add(self.label_min_length)

        self.dropdown_min_length = ComboBox()
        self.dropdown_min_length.Items.Add("15")
        self.dropdown_min_length.Items.Add("25")
        self.dropdown_min_length.Items.Add("50")
        self.dropdown_min_length.Items.Add("100")
        self.dropdown_min_length.Items.Add("150")
        self.dropdown_min_length.Items.Add("200")
        self.dropdown_min_length.Items.Add("300")
        self.dropdown_min_length.Items.Add("400")
        self.dropdown_min_length.Items.Add("500")
        self.dropdown_min_length.SelectedIndex = 0
        self.dropdown_min_length.Location = Point(140, 120)
        self.dropdown_min_length.Size = Size(150, 30)
        self.dropdown_min_length.DropDownStyle = ComboBoxStyle.DropDownList
        self.Controls.Add(self.dropdown_min_length)

        # Botão de seleção de elemento vinculado
        self.btn_select_element = Button()
        self.btn_select_element.Text = "Selecione o tubo de alimentação"
        self.btn_select_element.BackColor = Color.Red
        self.btn_select_element.ForeColor = Color.White
        self.btn_select_element.Size = Size(200, 40)
        self.btn_select_element.Location = Point((self.ClientSize.Width - self.btn_select_element.Width) // 2, 170)
        self.btn_select_element.Anchor = AnchorStyles.Top
        self.btn_select_element.Click += self.on_select_element
        self.Controls.Add(self.btn_select_element)

        # Botão OK
        self.btn_ok = Button()
        self.btn_ok.Text = "OK"
        self.btn_ok.Location = Point(125, 220)
        self.btn_ok.Click += self.on_ok
        self.Controls.Add(self.btn_ok)
        
        # Informação da empresa
        self.company_info = Label()
        self.company_info.Text = 'Versão 1.0\nBIM Coder | Première Engenharia\nBy: Fellipe Caetano\nIG: @bimcoder YT: _bimcoder\ncontato@bimcoder.net'
        self.company_info.Location = Point(10, 270)
        self.company_info.Size = Size(280, 80)
        self.company_info.ForeColor = Color.White  # Cor do texto branca
        self.Controls.Add(self.company_info) 

    def populate_tag_families(self):
        self.dropdown_tag_family.Items.Clear()
        
        # Obter as famílias de tags de tubos
        collector = FilteredElementCollector(doc).OfCategory(BuiltInCategory.OST_PipeTags).OfClass(FamilySymbol)
        tag_families = sorted(set(symbol.Family.Name for symbol in collector))

        # Colocar "TAG-FLUXO.DIAMETRO COMPACTA" como o primeiro item, se existir
        if tag_principal in tag_families:
            self.dropdown_tag_family.Items.Add(tag_principal)
            tag_families.remove(tag_principal)   

        for family in tag_families:
            self.dropdown_tag_family.Items.Add(family)

        # Definir o primeiro item selecionado como "TAG-FLUXO.DIAMETRO COMPACTA"
        self.dropdown_tag_family.SelectedIndex = 0

    def on_select_element(self, sender, event):
        self.Hide()
        doc = DocumentManager.Instance.CurrentDBDocument
        uidoc = DocumentManager.Instance.CurrentUIApplication.ActiveUIDocument
        global selected_element, doclnk, lnkinst, transform
        try:
            #Referência do elemento
            reference = uidoc.Selection.PickObject(ObjectType.LinkedElement, "Selecione o tubo de alimentação")
            
            lnkinst = doc.GetElement(reference) #Instância do vínculo
            doclnk = lnkinst.GetLinkDocument() #Documento do vínculo
            transform = lnkinst.GetTransform()  # Obtém a transformação do vínculo
            main_pipe_candidate = doclnk.GetElement(reference.LinkedElementId) #Elemento selecionado
                   
            if main_pipe_candidate.Category.Id.IntegerValue == int(BuiltInCategory.OST_PipeCurves):
                self.btn_select_element.BackColor = Color.Green  # Change button color to green
                self.btn_select_element.Text = 'Elemento selecionado!'
                selected_element = main_pipe_candidate
                self.Show()
                self.StartPosition = FormStartPosition.CenterScreen
                self.BringToFront()
            else:
                selected_element = None
                TaskDialog.Show('Aviso', 'Por favor, selecione um tubo!')
                self.Show()
                self.StartPosition = FormStartPosition.CenterScreen
                self.BringToFront()
        except Exception as e:
            selected_element = None
            TaskDialog.Show('Erro', str(e))
            self.Show()
            self.StartPosition = FormStartPosition.CenterScreen
            self.BringToFront()

    def on_ok(self, sender, event):
        global tag_position, min_length, selected_tag_family
        # Obter os valores das entradas do formulário
        tag_position = self.dropdown_tag_pos.SelectedItem
        min_length = self.dropdown_min_length.SelectedItem 
        selected_tag_family = self.dropdown_tag_family.SelectedItem

        # Verificar se um elemento foi selecionado
        if selected_element is None:
            TaskDialog.Show('Aviso', 'Por favor, selecione um tubo!')
            self.Show()
            self.StartPosition = FormStartPosition.CenterScreen
            self.BringToFront()
            return
            
        self.Close()

# Inicializar e executar o formulário
form = MyForm()
Application.Run(form)

# Retornar os resultados
form_result = (tag_position, int(min_length), selected_element, doclnk, lnkinst, transform,selected_tag_family)

OUT = form_result
# ----------------------------------------
definir_os_trechos = Python(IN[0]=formulário)  # CPython3
# ---------- definir_os_trechos.python (168 lines) ----------
import clr
import sys
import System
from System.Collections.Generic import *

clr.AddReference('ProtoGeometry')
from Autodesk.DesignScript.Geometry import *

clr.AddReference('RevitNodes')
import Revit
clr.ImportExtensions(Revit.Elements)
clr.ImportExtensions(Revit.GeometryConversion)

clr.AddReference("RevitServices")
import RevitServices
from RevitServices.Persistence import DocumentManager
from RevitServices.Transactions import TransactionManager

clr.AddReference('RevitAPI')
clr.AddReference('RevitAPIUI')
import Autodesk 
from Autodesk.Revit.DB import *  
from Autodesk.Revit.UI import *
from Autodesk.Revit.UI.Selection import *
  
import math     

doc = DocumentManager.Instance.CurrentDBDocument
uiapp = DocumentManager.Instance.CurrentUIApplication
app = uiapp.Application
uidoc = uiapp.ActiveUIDocument

tag_position = IN[0][0]
min_length = IN[0][1]
selected_element = UnwrapElement(IN[0][2])
doclnk = IN[0][3]
lnkinst = IN[0][4]
transform = IN[0][5]

# Função para mostrar um TaskDialog
def show_task_dialog(title, message):
    TaskDialog.Show(title, message)

main_pipe = selected_element

view = doc.ActiveView  
 
debug_info = []  # Lista para armazenar mensagens de depuração 

def get_connector_manager(element):
    if hasattr(element, 'ConnectorManager') and element.ConnectorManager is not None:
        debug_info.append(f"ConnectorManager encontrado diretamente no elemento {element.Id}")
        return element.ConnectorManager
    elif hasattr(element, 'MEPModel') and element.MEPModel and hasattr(element.MEPModel, 'ConnectorManager'):
        debug_info.append(f"ConnectorManager encontrado via MEPModel no elemento {element.Id}")
        return element.MEPModel.ConnectorManager
    debug_info.append(f"Nenhum ConnectorManager disponível para o elemento {element.Id}")
    return None

def is_element_visible_in_view(view, element, transform):
    # Obter o BoundingBox do elemento no espaço do vínculo
    element_bb = element.get_BoundingBox(None)
    
    
    if isinstance(view, View3D):  
        view_bb = view.GetSectionBox().ToProtoType().ToCuboid()
        
        # Aplicar a transformação ao BoundingBox
        min_pt = element_bb.Min
        max_pt = element_bb.Max
        
        min_pt_transformed = transform.OfPoint(min_pt)
        max_pt_transformed = transform.OfPoint(max_pt)
        
        transformed_bb = BoundingBoxXYZ()
        transformed_bb.Min = min_pt_transformed
        transformed_bb.Max = max_pt_transformed
        
        element_bb = transformed_bb     
        
    else:   
        view_bb = view.CropBox.ToProtoType().ToCuboid() 
     
    # Converter para ProtoType para comparação
    element_bb_proto = element_bb.ToProtoType().ToCuboid()
    
  
    # Conferir se há conflito da BB do elemento com BB da vista
    if Geometry.DoesIntersect(element_bb_proto, view_bb):
        return True
    else:
        return False           
           
def filter_elements(view, element, transform):
    category = element.Category
    if not category or category.Id.IntegerValue not in (
        BuiltInCategory.OST_PipeCurves,
        BuiltInCategory.OST_PipeFitting,
        BuiltInCategory.OST_PlumbingFixtures,
        BuiltInCategory.OST_PipeAccessory
    ):
        debug_info.append(f"Elemento {element.Id} não está em uma categoria processável.")
        return False
    
    if not is_element_visible_in_view(view, element, transform):
        debug_info.append(f"Elemento {element.Id} não está visível na vista {view.Id}.")
        return False
    
    debug_info.append(f"Elemento {element.Id} está na categoria {category.Name} e visível na vista.")
    return True

def follow_branch(element, branch, visited, branches, transform):
    if element.Id in visited:
        debug_info.append(f"Elemento {element.Id} já visitado, ignorando...")
        return
    if not filter_elements(view, element, transform):
        debug_info.append(f"Elemento {element.Id} não está na categoria correta ou não está visível na vista, ignorando...")
        return
    visited.add(element.Id)
    debug_info.append(f"Visitando elemento {element.Id}, ramo atual: {branch}")
    branch.append(element)

    connector_manager = get_connector_manager(element)
    if connector_manager:
        connected_elements = []
        for connector in connector_manager.Connectors:
            if connector.AllRefs:
                for ref in connector.AllRefs:
                    connected_element = doclnk.GetElement(ref.Owner.Id)
                    if connected_element and connected_element.Id != element.Id and connected_element.Id not in visited and filter_elements(view, connected_element, transform):
                        connected_elements.append(connected_element)

        if len(connected_elements) > 1: 
            branches.append(list(branch))
            for connected in connected_elements:
                follow_branch(connected, [], visited, branches, transform)
        elif connected_elements: 
            follow_branch(connected_elements[0], branch, visited, branches, transform)
        else:
            branches.append(branch)
    else: 
        branches.append(branch)
        
def get_system_type(element):
    connector_manager = get_connector_manager(element)
    if connector_manager:
        for connector in connector_manager.Connectors:
            if connector.MEPSystem:
                return connector.MEPSystem.GetTypeId()
    return None


def remove_incorrect_system_type(branches):
    result=[]
    system_type = get_system_type(branches[0][0])
    for list in branches:
        firstItem = list[0]
        if get_system_type(firstItem)==system_type:
            result.append(list)
    
    return result

branches = []  
 
TransactionManager.Instance.EnsureInTransaction(doc)
follow_branch(main_pipe, [], set(), branches, transform)
TransactionManager.Instance.TransactionTaskDone()
OUT = remove_incorrect_system_type(branches), lnkinst,debug_info
# ----------------------------------------
trechos = List.FirstItem(list=definir_os_trechos)
definir_as_direções = Python(IN[0]=trechos)  # CPython3
# ---------- definir_as_direções.python (107 lines) ----------
import clr
clr.AddReference('RevitAPI')
clr.AddReference('RevitServices')
clr.AddReference('ProtoGeometry')
from Autodesk.Revit.DB import *
from RevitServices.Persistence import DocumentManager
from RevitServices.Transactions import TransactionManager
from Autodesk.DesignScript.Geometry import Vector, Point

doc = DocumentManager.Instance.CurrentDBDocument
uiapp = DocumentManager.Instance.CurrentUIApplication
active_view = doc.ActiveView

# Obter a direção para cima e para frente da vista
view_up = active_view.UpDirection
view_right = active_view.RightDirection

lists_of_elements = IN[0]
element_vector_tags = []

# Lista para armazenar mensagens de depuração
debug_messages = []

TransactionManager.Instance.EnsureInTransaction(doc)
debug_messages.append("Iniciando transação")

# Iterar sobre cada lista de elementos
for elements in lists_of_elements:
    dynamo_points = []

    for elem in elements:
        elem = UnwrapElement(elem)
        debug_messages.append(f"Processando elemento: {elem.Id}")
        try:
            category = elem.Category.Id
            if category == ElementId(BuiltInCategory.OST_PipeCurves):
                location_curve = elem.Location
                if isinstance(location_curve, LocationCurve):
                    curve = location_curve.Curve
                    midpoint = curve.Evaluate(0.5, True)
                    end_point = curve.GetEndPoint(1)
                    dynamo_point = Point.ByCoordinates(midpoint.X, midpoint.Y, midpoint.Z)
                    end_dynamo_point = Point.ByCoordinates(end_point.X, end_point.Y, end_point.Z)
                    dynamo_points.append((elem, dynamo_point, end_dynamo_point))  # Associa o tubo ao ponto
                    debug_messages.append(f"Adicionado ponto para tubo: {dynamo_point}")
            elif category == ElementId(BuiltInCategory.OST_PipeFitting) or category == ElementId(BuiltInCategory.OST_PipeAccessory):
                location_point = elem.Location
                if isinstance(location_point, LocationPoint):
                    fitting_point = Point.ByCoordinates(location_point.Point.X, location_point.Point.Y, location_point.Point.Z)
                    dynamo_points.append((elem, fitting_point))  # Associa o joelho ao ponto
                    debug_messages.append(f"Adicionado ponto para joelho: {fitting_point}")
        except Exception as e:
            debug_messages.append(f"Erro ao processar elemento {elem.Id}: {str(e)}")

    for i in range(len(dynamo_points)):
        if len(dynamo_points[i]) == 3:  # É um tubo
            tube_elem, start_point, end_dynamo_point = dynamo_points[i]
            if i < len(dynamo_points) - 1 and len(dynamo_points[i + 1]) == 2:  # Próximo elemento é uma conexão
                fitting_elem, end_point = dynamo_points[i + 1]
            else:
                end_point = end_dynamo_point

            vector = Vector.ByTwoPoints(start_point, end_point)
            debug_messages.append(f"Vetor criado entre {start_point} e {end_point}: {vector}")

            # Verificar se o vetor original é vertical
            is_vertical = round(vector.X, 2) == 0 and round(vector.Y, 2) == 0

            if is_vertical:
                if not isinstance(active_view, ViewPlan):
                    if vector.Z > 0:
                        tag = "Seta para Cima"
                    elif vector.Z < 0:
                        tag = "Seta para Baixo"
                    else:
                        tag = "Sem direção definida"
                else:
                    continue
            else:
                if isinstance(active_view, ViewPlan):
                    # Para vistas de planta, usamos as componentes X e Y do vetor diretamente
                    vector_x = vector.X
                    vector_y = vector.Y
                else:
                    # Projetar o vetor nas direções da vista
                    vector_x = vector.Dot(Vector.ByCoordinates(view_right.X, view_right.Y, view_right.Z))
                    vector_y = vector.Dot(Vector.ByCoordinates(view_up.X, view_up.Y, view_up.Z))
                debug_messages.append(f"Componentes do vetor projetado - X: {vector_x}, Y: {vector_y}")

                if vector_x > 0:
                    tag = "Seta para Direita"
                elif vector_x < 0:
                    tag = "Seta para Esquerda"
                elif vector_y > 0:
                    tag = "Seta para Cima"
                elif vector_y < 0:
                    tag = "Seta para Baixo"
                else:
                    tag = "Sem direção definida"

            element_vector_tags.append((tube_elem, vector, tag))
            debug_messages.append(f"Elemento {tube_elem.Id} associado ao vetor {vector} com tag {tag}")

TransactionManager.Instance.TransactionTaskDone()
debug_messages.append("Transação concluída")

OUT = element_vector_tags, debug_messages
# ----------------------------------------

# group: Debugs
trechos_separados = Watch(definir_os_trechos)
tubos_vetores_e_direções = Watch(definir_as_direções)

tubos_e_direções = List.FirstItem(list=definir_as_direções)
resultados = CodeBlock(IN=definir_os_trechos, t2=tubos_e_direções) { linkInstance = IN[1]; pipes = List.GetItemAtIndex(t2@L2<1>, 0); directions = List.GetItemAtIndex(t2@L2<1>, 2); }
inserir_tags = Python(IN[0]=resultados.linkInstance, IN[1]=resultados.pipes, IN[2]=resultados.directions, IN[3]=formulário)  # CPython3; graph output
# ---------- inserir_tags.python (111 lines) ----------
import clr
clr.AddReference('RevitServices')
import RevitServices
from RevitServices.Persistence import DocumentManager
from RevitServices.Transactions import TransactionManager

clr.AddReference('RevitAPI')
clr.AddReference('RevitAPIUI')
from Autodesk.Revit.DB import *
from Autodesk.Revit.UI import *

import math

# Função para mostrar um TaskDialog
def show_task_dialog(title, message):
    TaskDialog.Show(title, message)

def getTagTypeName(direction, tagPosition):
    if direction in ["Seta para Baixo", "Seta para Esquerda"]:
        if tagPosition == "Tag abaixo":
            return "Ø ↓ + ( ← ↓ )"
        else:
            return "Ø ↑ + ( ← ↓ )"           
   
    elif direction in ["Seta para Cima", "Seta para Direita"]:
        if tagPosition == "Tag abaixo":  
            return "Ø ↓ + ( → ↑ )"
        else:
            return "Ø ↑ + ( → ↑ )"
            
    elif direction == "Sem direção definida":
        return "Ø"
   
    else:
        raise ValueError("Direção inválida fornecida: {}".format(direction))

def TagLinkedPipe(doc, linkedPipe, linkInstance, tagTypeName, tolerance):
    # Obter a localização do tubo
    location = linkedPipe.Location
    
    # Obter a curva do tubo
    curve = location.Curve
    
    # Obter o comprimento do tubo
    pipeLength = linkedPipe.get_Parameter(BuiltInParameter.CURVE_ELEM_LENGTH).AsDouble()
    pipeLength = UnitUtils.ConvertFromInternalUnits(pipeLength,UnitTypeId.Centimeters)

    # Calcular o ponto médio da curva do tubo
    midPoint = curve.Evaluate(0.5, True)
    
    # Aplicar a transformação ao ponto médio 
    transform = linkInstance.GetTransform()  
    transformedMidPoint = transform.OfPoint(midPoint)

    # Verificar se o link está carregado e se o tubo está dentro da faixa de tolerância
    type = doc.GetElement(linkInstance.GetTypeId()) 
    if RevitLinkType.IsLoaded(doc, type.Id) and pipeLength >= tolerance:
        # Encontrar a família de tags
        tagFamily = FilteredElementCollector(doc).OfClass(FamilySymbol).OfCategory(BuiltInCategory.OST_PipeTags).ToElements()
        tagFamily = [f for f in tagFamily if f.Family.Name == tag_family and f.get_Parameter(BuiltInParameter.SYMBOL_NAME_PARAM).AsString() == tagTypeName][0]

        tagFamily.Activate()
 
        # Criar referência
        newRef = Reference(linkedPipe).CreateLinkReference(linkInstance)
 
        # Criar transação
        TransactionManager.Instance.EnsureInTransaction(doc)
        
        newTag = IndependentTag.Create(
            doc, tagFamily.Id, doc.ActiveView.Id, newRef, False,       
            TagOrientation.Horizontal, transformedMidPoint)   

        TransactionManager.Instance.TransactionTaskDone()
       
        return newTag  

# Obter o documento atual
doc = DocumentManager.Instance.CurrentDBDocument  

# Obter os elementos vinculados e direções a partir da entrada do nó Dynamo
linkInstance = UnwrapElement(IN[0])
linkedPipes = UnwrapElement(IN[1])
directions = IN[2]
tagPosition = IN[3][0]
tolerance = IN[3][1]
tag_family = IN[3][6]

# Garantir que as entradas sejam listas
if not isinstance(linkedPipes, list):
    linkedPipes = [linkedPipes]
if not isinstance(directions, list):
    directions = [directions]

# Verificar se o número de tubos e direções é o mesmo
if len(linkedPipes) != len(directions):
    raise ValueError("O número de tubos e direções deve ser o mesmo.")

# Chamar a função para marcar os tubos no documento vinculado
result = []

for pipe, direction in zip(linkedPipes, directions):
    tagTypeName = getTagTypeName(direction,tagPosition)
    tag = TagLinkedPipe(doc, pipe, linkInstance, tagTypeName, tolerance)
    if tag != None:
        result.append(tag)

show_task_dialog("Aviso","Tags inseridas com sucesso!")

# Definir a saída do script
OUT = result
# ----------------------------------------
